# Grasshopper definition regular tetrahedron.gh (Grasshopper 1.0.7)
# plug-ins: Kangaroo2 Components

number_slider = Slider(7, range=0..100)
a_x_y = GhPythonScript(x=number_slider, y=Slider(2, range=0..100))  # -> out, a
# ---------- a_x_y: Python ----------
__author__ = "sator"
__version__ = "2023.04.26"

import rhinoscriptsyntax as rs

a = x * y
# ---------- end a_x_y ----------
a_x_y_2 = GhPythonScript(x=Slider(1, range=0..100), y=Slider(5, range=0..100))  # -> out, a
# ---------- a_x_y_2: Python ----------
__author__ = "sator"
__version__ = "2023.04.26"

import rhinoscriptsyntax as rs

a = x / y
# ---------- end a_x_y_2 ----------
radgrid = Radial(Plane=PlaneXY(0, 0, 0), Size=number_slider, ExtentR=Slider(1, range=0..100), ExtentP=Slider(5, range=0..100))  # -> Cells, Points; disabled
panel = Panel(radgrid.Points)
vec = VectorXYZ(XComponent=Slider(0, range=0..50), YComponent=Slider(0, range=0..50), ZComponent=Slider(0, range=0..50))  # -> Vector, Length
pi = Pi(Factor=a_x_y_2.a)
sqrt = SquareRoot(Value=Slider(2, range=0..50))
division = Division(A=sqrt, B=Slider(4, range=0..50))
item = ListItem(List=radgrid.Points, Index=Slider(0, range=0..100), Wrap=True)
panel_2 = Panel(item)
vec_2 = VectorXYZ(XComponent=Slider(0, range=0..50), YComponent=Slider(0, range=0..50), ZComponent=division)  # -> Vector, Length
rotate = Rotate(Geometry=radgrid.Points, Angle=pi, Plane=PlaneXY(0, 0, 0))  # -> Geometry, Transform
X = UnitX(Factor=1)
Y = UnitY(Factor=1)
Z = UnitZ(Factor=1)
_4face = GhPythonScript()  # -> out, a, b
# ---------- _4face: Python ----------
__author__ = "sator"
__version__ = "2023.04.28"

import rhinoscriptsyntax as rs
import math

faces = []
triangle_points = []

for i in range(0, 3):
    angle = 2.0 * math.pi / 3 * i
    triangle_points.append(rs.CreatePoint([math.cos(angle), math.sin(angle), 0]))

triangle_points.append(rs.CreatePoint([0, 0, math.sqrt(2)]));


faces.append(rs.AddSrfPt([triangle_points[2], triangle_points[1], triangle_points[0]]))
faces.append(rs.AddSrfPt([triangle_points[0], triangle_points[1], triangle_points[3]]))
faces.append(rs.AddSrfPt([triangle_points[1], triangle_points[2], triangle_points[3]]))
faces.append(rs.AddSrfPt([triangle_points[2], triangle_points[0], triangle_points[3]]))

a = faces
# ---------- end _4face ----------
ln = Line(StartPoint=X, EndPoint=vec.Vector)
panel_3 = Panel(rotate.Geometry)
vec_3 = VectorXYZ(XComponent=Slider(0, range=0..50), YComponent=Slider(0, range=0..50), ZComponent=Slider(0, range=0..50))  # -> Vector, Length
ln_2 = Line(StartPoint=Y, EndPoint=vec.Vector)
ln_3 = Line(StartPoint=Z, EndPoint=vec.Vector)
base_hexagon = SimpleMesh(Brep=radgrid.Cells)  # disabled
subtraction = Subtraction(A=vec_3.Vector, B=vec_2.Vector)
move = Move(Geometry=_4face.a, Motion=subtraction)  # -> Geometry, Transform
origin = VectorXYZ(XComponent=Slider(0, range=0..10), YComponent=Slider(0, range=0..10), ZComponent=Slider(0, range=0..10))  # -> Vector, Length
scale = Scale(Geometry=rotate.Geometry, Center=origin.Vector, Factor=Slider(2, range=0..10))  # -> Geometry, Transform
rad = Radians(Degrees=Slider(180, range=0..360))
rotax = RotateAxis(Geometry=move.Geometry, Angle=rad, Axis=ln)  # -> Geometry, Transform
vec2pt = Vector2Pt(PointA=scale.Geometry, PointB=origin.Vector, Unitize=False)  # -> Vector, Length
rad_2 = Radians(Degrees=Slider(125, range=0..360))
panel_4 = Panel(vec2pt.Vector)
python = GhPythonScript(x=base_hexagon, y=vec2pt.Vector)  # -> out, a
# ---------- python: Python ----------
__author__ = "sator"
__version__ = "2023.04.26"

import rhinoscriptsyntax as rs

a = []

a.append(x)

for p in y:
    print p
    
print "len(y) ={}".format(len(y))
for i in range(int((len(y) / 3))):
    print "i={}".format(i)
    print "({},{},{})".format(y[i])
        
    
    #rs.TransformObject(x, rs.XformTranslation(p))
    #a.append(x)
# ---------- end python ----------
rotax_2 = RotateAxis(Geometry=rotax.Geometry, Angle=rad_2, Axis=ln_2)  # -> Geometry, Transform
pcen = PolygonCenter(Polyline=rotax_2.Geometry)  # -> CenterV, CenterE, CenterA
del = DelaunayMesh(Points=reverse(pcen.CenterV), Plane=PlaneXY(0, 0, 0))
del_2 = DelaunayMesh(Points=pcen.CenterV, Plane=PlaneXY(0, 0, 0))
merge = Merge(Data1=del, Data2=del_2)
mjoin = MeshJoin(Meshes=merge)
faceb = FaceBoundaries(Mesh=mjoin)
boundary = BoundarySurfaces(Edges=faceb)
bvol = BoundaryVolume(Boundaries=rotax_2.Geometry)
bvol_2 = BoundaryVolume(Boundaries=boundary)
scale_2 = Scale(Geometry=bvol_2, Center=vec.Vector, Factor=Slider(3, range=0.001..10))  # -> Geometry, Transform
midpt = CurveMiddle()
sint = SolidIntersection(BrepsA=bvol, BrepsB=scale_2.Geometry)
edges = BrepEdges(Brep=sint)  # -> Naked, Interior, NonManifold
end = EndPoints(Curve=edges.Interior)  # -> Start, End
del_3 = DelaunayMesh(Plane=PlaneXY(0, 0, 0))
preview = CustomPreview(
    Geometry=sint,
    Material={diffuse=RGB(221, 160, 221), emission=RGB(66, 48, 66), shine=0.5, specular=RGB(255, 255, 255), transparency=0})
divlength = DivideLength(Curve=edges.Interior, Length=Slider(0.744, range=0.001..10))  # -> flatten(Points), Tangents, Parameters
debrep = DeconstructBrep(Brep=sint)  # -> Faces, Edges, Vertices
edges_2 = BrepEdges(Brep=sint)  # -> Naked, Interior, NonManifold
pcen_2 = PolygonCenter(Polyline=debrep.Faces)  # -> CenterV, CenterE, CenterA
crv = Curve(debrep.Edges)
midpt_2 = CurveMiddle(Curve=crv)
pdecon = Deconstruct(Point=midpt_2)  # -> XComponent, YComponent, ZComponent
sort = SortList(Keys=pdecon.ZComponent, ValuesA=crv)  # -> Keys, ValuesA
rev = ReverseList(List=sort.ValuesA)
item_2 = ListItem(List=rev, Index=Slider(0, range=0..10), Wrap=True)
partition = PartitionList(List=rev, Size=Slider(4, range=0..10))
midpt_3 = CurveMiddle(Curve=partition)
fcircle = CircleFit(Points=midpt_3)  # -> Circle, Radius, Deviation
crv_cp = CurveClosestPoint(Point=midpt_3, Curve=fcircle.Circle)  # -> Point, Parameter, Distance
sort_2 = SortList(Keys=crv_cp.Parameter, ValuesA=partition)  # -> Keys, ValuesA
crv_2 = Curve(flatten(sort_2.ValuesA))  # disabled
panel_5 = Panel(crv_2)
lng = ListLength(List=flatten(sort_2.ValuesA))
end_2 = EndPoints(Curve=sort_2.ValuesA)  # -> Start, End
midpt_4 = CurveMiddle(Curve=crv_2)
series = Series(Start=0, Step=1, Count=flatten(lng))
item_3 = ListItem(List=crv_2, Index=Slider(0, range=0..10), Wrap=True)
points = PointList(Points=midpt_4)
mod = Modulus(A=series, B=Slider(2, range=0..10))
dispatch = Dispatch(List=sort_2.ValuesA, DispatchPattern=mod)  # -> ListA, ListB
panel_6 = Panel(dispatch.ListA)
crv_3 = Curve(dispatch.ListB)
crv_4 = Curve(dispatch.ListA)
crv_5 = Curve(crv_4)
end_3 = EndPoints(Curve=crv_3)  # -> Start, End
pt = Point(end_3.End)
end_4 = EndPoints(Curve=crv_5)  # -> Start, End
pt_2 = Point(end_3.Start)
pdecon_2 = Deconstruct(Point=pt)  # -> XComponent, YComponent, ZComponent
pdecon_3 = Deconstruct(Point=pt_2)  # -> XComponent, YComponent, ZComponent
pt_3 = Point(end_4.End)
pt_4 = Point(end_4.Start)
pdecon_4 = Deconstruct(Point=pt_3)  # -> XComponent, YComponent, ZComponent
pdecon_5 = Deconstruct(Point=pt_4)  # -> XComponent, YComponent, ZComponent
larger = LargerThan(FirstNumber=pdecon_3.ZComponent, SecondNumber=pdecon_2.ZComponent)  # -> LargerThan, OrEqualTo
dispatch_2 = Dispatch(List=crv_3, DispatchPattern=larger.LargerThan)  # -> ListA, ListB
index = ItemIndex(List=crv_3, Item=dispatch_2.ListA)
smaller = SmallerThan(FirstNumber=pdecon_5.ZComponent, SecondNumber=pdecon_4.ZComponent)  # -> SmallerThan, OrEqualTo
dispatch_3 = Dispatch(List=crv_5, DispatchPattern=smaller.SmallerThan)  # -> ListA, ListB
index_2 = ItemIndex(List=crv_5, Item=dispatch_3.ListA)
flip = FlipCurve(Curve=dispatch_2.ListA)  # -> Curve, Flag
flip_2 = FlipCurve(Curve=dispatch_3.ListA)  # -> Curve, Flag
replace = ReplaceItems(List=crv_3, Item=flip.Curve, Indices=index, Wrap=False)
replace_2 = ReplaceItems(List=crv_5, Item=flip_2.Curve, Indices=index_2, Wrap=False)
midpt_5 = CurveMiddle(Curve=replace)
midpt_6 = CurveMiddle(Curve=replace_2)
pdecon_6 = Deconstruct(Point=midpt_5)  # -> XComponent, YComponent, ZComponent
pdecon_7 = Deconstruct(Point=midpt_6)  # -> XComponent, YComponent, ZComponent
smaller_2 = SmallerThan(FirstNumber=pdecon_6.ZComponent, SecondNumber=Slider(0, range=0..10))  # -> SmallerThan, OrEqualTo
dispatch_4 = Dispatch(List=replace, DispatchPattern=smaller_2.SmallerThan)  # -> ListA, ListB
index_3 = ItemIndex(List=replace, Item=dispatch_4.ListA)
smaller_3 = SmallerThan(FirstNumber=pdecon_7.ZComponent, SecondNumber=Slider(0, range=0..10))  # -> SmallerThan, OrEqualTo
dispatch_5 = Dispatch(List=replace_2, DispatchPattern=smaller_3.SmallerThan)  # -> ListA, ListB
index_4 = ItemIndex(List=replace_2, Item=dispatch_5.ListA)
flip_3 = FlipCurve(Curve=dispatch_4.ListA)  # -> Curve, Flag
flip_4 = FlipCurve(Curve=dispatch_5.ListA)  # -> Curve, Flag
replace_3 = ReplaceItems(List=replace, Item=flip_3.Curve, Indices=index_3, Wrap=False)
replace_4 = ReplaceItems(List=replace_2, Item=flip_4.Curve, Indices=index_4, Wrap=False)
end_5 = EndPoints(Curve=replace_4)  # -> Start, End
pdecon_8 = Deconstruct(Point=end_5.Start)  # -> XComponent, YComponent, ZComponent
panel_7 = Panel(pdecon_8.ZComponent)
pdecon_9 = Deconstruct(Point=end_5.End)  # -> XComponent, YComponent, ZComponent
panel_8 = Panel(pdecon_9.ZComponent)
subtraction_2 = Subtraction(A=pdecon_8.ZComponent, B=pdecon_9.ZComponent)
abs = Absolute(Value=subtraction_2)
smaller_4 = SmallerThan(FirstNumber=abs, SecondNumber=Slider(0.01, range=0..1))  # -> SmallerThan, OrEqualTo
dispatch_6 = Dispatch(List=replace_4, DispatchPattern=smaller_4.SmallerThan)  # -> ListA, ListB
index_5 = ItemIndex(List=replace_4, Item=dispatch_6.ListA)
flip_5 = FlipCurve(Curve=dispatch_6.ListA)  # -> Curve, Flag
replace_5 = ReplaceItems(List=replace_4, Item=flip_5.Curve, Indices=index_5, Wrap=False)
panel_9 = Panel("0.604207")
num = Number(Slider(0.604207, range=0.001..1))
eval = EvaluateLength(Curve=replace_5, Length=num, Normalized=True)  # -> Point, Tangent, Parameter
eval_2 = EvaluateLength(Curve=replace_3, Length=num, Normalized=True)  # -> Point, Tangent, Parameter
merge_2 = Merge(Data1=flatten(eval.Point), Data2=flatten(eval_2.Point))
panel_10 = Panel(merge_2)
pt_5 = Point(graft(merge_2))
panel_11 = Panel(pt_5)
difference = SetDifference(SetA=merge_2, SetB=pt_5)
panel_12 = Panel(difference)
cps = ClosestPoints(Point=pt_5, Cloud=difference, Count=Slider(5, range=0..10))  # -> ClosestPoint, CPIndex, Distance
ln_4 = Line(StartPoint=cps.ClosestPoint, EndPoint=pt_5)
panel_13 = Panel(ln_4)
line = Line(flatten(ln_4))
dupln = RemoveDuplicateLines(Lines=line, Tolerance=0.01)
line_2 = Line(graft(dupln))
line_3 = Line(dupln)
number_slider_2 = Slider(10, range=0..32)
series_2 = Series(Start=0, Step=1, Count=Slider(0, range=0..32))  # -> graft(Series)
midpt_7 = CurveMiddle(Curve=line_3)
midpt_8 = CurveMiddle(Curve=line_2)
dist = Distance(PointA=midpt_8, PointB=midpt_7)
sort_3 = SortList(Keys=dist, ValuesA=line_3)  # -> Keys, ValuesA
index_6 = ItemIndex(List=sort_3.ValuesA, Item=sort_3.ValuesA)
smaller_5 = SmallerThan(FirstNumber=index_6, SecondNumber=Slider(5, range=0..31))  # -> SmallerThan, OrEqualTo
equals = Equality(FirstNumber=index_6, SecondNumber=Slider(0, range=0..31))  # -> Equality, Inequality
and = GateAnd(A=equals.Inequality, B=smaller_5.SmallerThan)
dispatch_7 = Dispatch(List=sort_3.ValuesA, DispatchPattern=and)  # -> ListA, ListB
midpt_9 = CurveMiddle(Curve=dispatch_7.ListA)
fcircle_2 = CircleFit(Points=midpt_9)  # -> Circle, Radius, Deviation
crv_cp_2 = CurveClosestPoint(Point=midpt_9, Curve=fcircle_2.Circle)  # -> Point, Parameter, Distance
line_4 = Line(line_2)
sort_4 = SortList(Keys=crv_cp_2.Parameter, ValuesA=dispatch_7.ListA)  # -> Keys, ValuesA
panel_14 = Panel(sort_4.ValuesA)
edgesrf = EdgeSurface(CurveA=line_4, CurveB=sort_4.ValuesA)  # -> flatten(Surface)
number_slider_3 = Slider(0, range=0..31)
srf = Surface(graft(edgesrf))
facen = FaceNormals(Mesh=srf)  # -> Centers, Normals
vec_4 = VectorXYZ(XComponent=number_slider_3, YComponent=number_slider_3, ZComponent=number_slider_3)  # -> Vector, Length
pt_6 = Point(vec_4.Vector)
subtraction_3 = Subtraction(A=pt_6, B=facen.Centers)
dprod = DotProduct(VectorA=facen.Normals, VectorB=subtraction_3, Unitize=False)
srf_cp = SurfaceClosestPoint()  # -> Point, UVPoint, Distance
larger_2 = LargerThan(FirstNumber=dprod, SecondNumber=Slider(0, range=0..31))  # -> LargerThan, OrEqualTo
dispatch_8 = Dispatch(List=srf, DispatchPattern=larger_2.LargerThan)  # -> ListA, ListB
srf_2 = Surface(flatten(dispatch_8.ListA))
panel_15 = Panel(srf_2)
bvol_3 = BoundaryVolume(Boundaries=srf_2)
edges_3 = BrepEdges(Brep=bvol_3)  # -> Naked, Interior, NonManifold
preview_2 = CustomPreview(
    Geometry=bvol_3,
    Material={diffuse=RGB(221, 160, 221), emission=RGB(66, 48, 66), shine=0.5, specular=RGB(255, 255, 255), transparency=0})
dupln_2 = RemoveDuplicateLines(Lines=edges_3.Interior, Tolerance=0.01)
division_2 = Division(A=Slider(1, range=0..31), B=Slider(3, range=0..31))
subtraction_4 = Subtraction(A=Slider(1, range=0..31), B=division_2)
line_5 = Line(dupln_2)
pcen_3 = PolygonCenter(Polyline=srf_2)  # -> CenterV, CenterE, CenterA
eval_3 = EvaluateCurve(Curve=line_5, Parameter=subtraction_4)  # -> Point, Tangent, Angle
eval_4 = EvaluateCurve(Curve=line_5, Parameter=division_2)  # -> Point, Tangent, Angle
pt_7 = Point(graft(pcen_3.CenterV))
pt_8 = Point(pcen_3.CenterV)
merge_3 = Merge(Data1=eval_3.Point, Data2=eval_4.Point)
duppt = RemoveDuplicatePts(Points=merge_3, Tolerance=0.01)
cps_2 = ClosestPoints(Point=pt_7, Cloud=pt_8, Count=Slider(10, range=0..31))  # -> ClosestPoint, CPIndex, Distance
pt_9 = Point(duppt)
panel_16 = Panel(pt_9)
pt_10 = Point(graft(duppt))
ln_5 = Line(StartPoint=pt_7, EndPoint=cps_2.ClosestPoint)
index_7 = ItemIndex(List=pt_9, Item=pt_9)
index_8 = ItemIndex(List=pt_9, Item=pt_10)
equals_2 = Equality(FirstNumber=index_8, SecondNumber=index_7)  # -> Equality, Inequality
dispatch_9 = Dispatch(List=pt_9, DispatchPattern=equals_2.Inequality)  # -> ListA, ListB
panel_17 = Panel(pt_10)
panel_18 = Panel(dispatch_9.ListA)
cps_3 = ClosestPoints(Point=pt_10, Cloud=dispatch_9.ListA, Count=Slider(3, range=0..31))  # -> ClosestPoint, CPIndex, Distance
ln_6 = Line(StartPoint=pt_10, EndPoint=cps_3.ClosestPoint)  # -> flatten(Line)
dupln_3 = RemoveDuplicateLines(Lines=ln_6, Tolerance=0.01)
line_6 = Line(dupln_3)
line_7 = Line(graft(dupln_3))
end_6 = EndPoints(Curve=line_6)  # -> Start, End
merge_4 = Merge(Data1=end_6.Start, Data2=end_6.End)
duppt_2 = RemoveDuplicatePts(Points=merge_4, Tolerance=0.01)
len = Length(Curve=line_7)
pt_11 = Point(duppt_2)
multiplication = Multiplication(A=len, B=Slider(0.058, range=0..1))
msphere = MeshSphere(Base=pt_11, Radius=multiplication, UCount=10, VCount=20)  # -> flatten(Mesh)
pipe = Pipe(Curve=line_7, Radius=multiplication, Caps=0)  # -> flatten(Pipe)
merge_5 = Merge(Data1=pipe, Data2=msphere)
number_slider_4 = Slider(0, range=0..31)
vec_5 = VectorXYZ(XComponent=Slider(0, range=0..31), YComponent=Slider(18, range=0..31), ZComponent=Slider(6, range=0..31))  # -> Vector, Length
vec_6 = VectorXYZ(XComponent=number_slider_4, YComponent=number_slider_4, ZComponent=number_slider_4)  # -> Vector, Length
ln_7 = Line(StartPoint=vec_5.Vector, EndPoint=vec_6.Vector)
rotax_3 = RotateAxis(Geometry=merge_5, Angle=Slider(32, range=0..32), Axis=ln_7)  # -> Geometry, Transform
